# Dynamo graph 0_AssignLayer.dyn (Dynamo 2.10.1.3976)

# group: READ ME
# note: TBC...

# group: Collect all elements
code_block = CodeBlock { "Floors"; "Structural Columns"; "Structural Framing"; "Structural Foundations"; }
byName = Category.ByName(name=code_block.out3)
all_elements_of_category = ElementsOfCategory(Category=byName)
code_block_2 = CodeBlock { "Walls"; }
byName_2 = Category.ByName(name=code_block_2)
all_elements_of_category_2 = ElementsOfCategory(Category=byName_2)
byName_3 = Category.ByName(name=code_block.out1)
all_elements_of_category_3 = ElementsOfCategory(Category=byName_3)
byName_4 = Category.ByName(name=code_block.out2)
all_elements_of_category_4 = ElementsOfCategory(Category=byName_4)
byName_5 = Category.ByName(name=code_block.out0)
all_elements_of_category_5 = ElementsOfCategory(Category=byName_5)
code_block_3 = CodeBlock { "Roofs"; "Windows"; }
byName_6 = Category.ByName(name=code_block_3.out0)
all_elements_of_category_6 = ElementsOfCategory(Category=byName_6)
byName_7 = Category.ByName(name=code_block_3.out1)
all_elements_of_category_7 = ElementsOfCategory(Category=byName_7)
code_block_4 = CodeBlock { "Doors"; }
byName_8 = Category.ByName(name=code_block_4)
all_elements_of_category_8 = ElementsOfCategory(Category=byName_8)
code_block_5 = CodeBlock { "Ceilings"; "Columns"; }
byName_9 = Category.ByName(name=code_block_5.out0)
all_elements_of_category_9 = ElementsOfCategory(Category=byName_9)
byName_10 = Category.ByName(name=code_block_5.out1)
all_elements_of_category_10 = ElementsOfCategory(Category=byName_10)

# group: Dispatch structural walls
code_block_6 = CodeBlock { "Structural"; 1; }
getParameterValueByName = Element.GetParameterValueByName(element=all_elements_of_category_2, parameterName=code_block_6.out0)
eq = getParameterValueByName == code_block_6.out1
filterByBoolMask = List.FilterByBoolMask(list=all_elements_of_category_2, mask=eq)

code_block_7 = CodeBlock(foundations=all_elements_of_category, str_walls=filterByBoolMask.in, str_columns=all_elements_of_category_3, str_framing=all_elements_of_category_4, slabs=all_elements_of_category_5)
# ---------- code_block_7.designscript (7 lines) ----------
Structure = [
	foundations,
	str_walls,
	str_columns,
	str_framing,
	slabs
];
# ----------------------------------------

# group: Dispatch external walls
code_block_8 = CodeBlock { "Is internal"; true; }
getParameterValueByName_2 = Element.GetParameterValueByName(element=filterByBoolMask.out, parameterName=code_block_8.out0)
eq_2 = getParameterValueByName_2 == code_block_8.out1
code_block_9 = CodeBlock { ""; }
eq_3 = getParameterValueByName_2 == code_block_9
or_ = eq_2 || eq_3
filterByBoolMask_2 = List.FilterByBoolMask(list=filterByBoolMask.out, mask=or_)

# group: Dispatch doors ext/int
code_block_10 = CodeBlock(doors=all_elements_of_category_8) { doors; }
code_block_11 = CodeBlock { "Host Id"; }
getParameterValueByName_3 = Element.GetParameterValueByName(element=code_block_10, parameterName=code_block_11)
code_block_12 = CodeBlock { "Is internal"; true; }
getParameterValueByName_4 = Element.GetParameterValueByName(element=getParameterValueByName_3, parameterName=code_block_12.out0)
eq_4 = getParameterValueByName_4 == code_block_12.out1
code_block_13 = CodeBlock { ""; }
eq_5 = getParameterValueByName_4 == code_block_13
or_2 = eq_4 || eq_5
filterByBoolMask_3 = List.FilterByBoolMask(list=code_block_10, mask=or_2)

code_block_14 = CodeBlock(roof=all_elements_of_category_6, nstr_ext_walls=filterByBoolMask_2.out, windows=all_elements_of_category_7, ext_doors=filterByBoolMask_3.out)
# ---------- code_block_14.designscript (6 lines) ----------
Skin = [
	roof,
	nstr_ext_walls,
	windows,
	ext_doors
];
# ----------------------------------------
code_block_15 = CodeBlock(int_doors=filterByBoolMask_3.in, nstr_int_walls=filterByBoolMask_2.in, ceilings=all_elements_of_category_9, columns=all_elements_of_category_10)
# ---------- code_block_15.designscript (6 lines) ----------
SpacePlan = [
	int_doors,
	nstr_int_walls,
	ceilings,
	columns
];
# ----------------------------------------

# group: Write the information in parameters
code_block_16 = CodeBlock(Structure=code_block_7, Skin=code_block_14, SpacePlan=code_block_15) { Site; Structure; Skin; Services; SpacePlan; Stuff; }  # unwired: Site, Services, Stuff
code_block_17 = CodeBlock { "Building layer"; }
code_block_18 = CodeBlock { Site = 0; Structure = 1; Skin = 2; Services = 3; SpacePlan = 4; Stuff = 5; }
setParameterByName = Element.SetParameterByName(element=code_block_16.Structure, parameterName=code_block_17, value=code_block_18.Structure)
setParameterByName_2 = Element.SetParameterByName(element=code_block_16.SpacePlan, parameterName=code_block_17, value=code_block_18.SpacePlan)
setParameterByName_3 = Element.SetParameterByName(element=code_block_16.Skin, parameterName=code_block_17, value=code_block_18.Skin)
