# Dynamo graph 1_AssignLayer.dyn (Dynamo 2.10.1.3976)

# group: READ ME
# note: TBC...

# group: Get elements from groups
categories = Categories("OST_IOSModelGroups")  # frozen
all_elements_of_category = ElementsOfCategory(Category=categories)
getMembers = Group.GetMembers(group=all_elements_of_category)
flatten = List.Flatten(list=getMembers)
uniqueItems = List.UniqueItems(list=flatten)

# group: Collect all elements
code_block = CodeBlock { "Floors"; "Structural Columns"; "Structural Framing"; "Structural Foundations"; }
byName = Category.ByName(name=code_block.out3)
all_elements_of_category_2 = ElementsOfCategory(Category=byName)
code_block_2 = CodeBlock { "Walls"; }
byName_2 = Category.ByName(name=code_block_2)
all_elements_of_category_3 = ElementsOfCategory(Category=byName_2)
byName_3 = Category.ByName(name=code_block.out1)
all_elements_of_category_4 = ElementsOfCategory(Category=byName_3)
byName_4 = Category.ByName(name=code_block.out2)
all_elements_of_category_5 = ElementsOfCategory(Category=byName_4)
byName_5 = Category.ByName(name=code_block.out0)
all_elements_of_category_6 = ElementsOfCategory(Category=byName_5)
code_block_3 = CodeBlock { "Roofs"; "Windows"; }
byName_6 = Category.ByName(name=code_block_3.out0)
all_elements_of_category_7 = ElementsOfCategory(Category=byName_6)
byName_7 = Category.ByName(name=code_block_3.out1)
all_elements_of_category_8 = ElementsOfCategory(Category=byName_7)
code_block_4 = CodeBlock { "Doors"; }
byName_8 = Category.ByName(name=code_block_4)
all_elements_of_category_9 = ElementsOfCategory(Category=byName_8)
code_block_5 = CodeBlock { "Ceilings"; "Columns"; }
byName_9 = Category.ByName(name=code_block_5.out0)
all_elements_of_category_10 = ElementsOfCategory(Category=byName_9)
byName_10 = Category.ByName(name=code_block_5.out1)
all_elements_of_category_11 = ElementsOfCategory(Category=byName_10)

# group: Dispatch structural walls
code_block_6 = CodeBlock { "Structural"; 1; }
getParameterValueByName = Element.GetParameterValueByName(element=all_elements_of_category_3, parameterName=code_block_6.out0)
eq = getParameterValueByName == code_block_6.out1
filterByBoolMask = List.FilterByBoolMask(list=all_elements_of_category_3, mask=eq)

# group: Dispatch external walls
code_block_7 = CodeBlock { "Is internal"; true; }
getParameterValueByName_2 = Element.GetParameterValueByName(element=filterByBoolMask.out, parameterName=code_block_7.out0)
eq_2 = getParameterValueByName_2 == code_block_7.out1
code_block_8 = CodeBlock { ""; }
eq_3 = getParameterValueByName_2 == code_block_8
or_ = eq_2 || eq_3
filterByBoolMask_2 = List.FilterByBoolMask(list=filterByBoolMask.out, mask=or_)

# group: Dispatch doors ext/int
code_block_9 = CodeBlock(doors=all_elements_of_category_9) { doors; }
code_block_10 = CodeBlock { "Host Id"; }
getParameterValueByName_3 = Element.GetParameterValueByName(element=code_block_9, parameterName=code_block_10)
code_block_11 = CodeBlock { "-1"; }
eq_4 = getParameterValueByName_3 == code_block_11
filterByBoolMask_3 = List.FilterByBoolMask(list=getParameterValueByName_3, mask=eq_4)
code_block_12 = CodeBlock { "Is internal"; true; }
getParameterValueByName_4 = Element.GetParameterValueByName(element=filterByBoolMask_3.out, parameterName=code_block_12.out0)
eq_5 = getParameterValueByName_4 == code_block_12.out1
code_block_13 = CodeBlock { ""; }
eq_6 = getParameterValueByName_4 == code_block_13
or_2 = eq_5 || eq_6
code_block_14 = CodeBlock { true; }
allIndicesOf = List.AllIndicesOf(list=eq_4, item=code_block_14)
python_script = Python(IN[0]=or_2, IN[1]=allIndicesOf)  # IronPython2
# ---------- python_script.python (6 lines) ----------
result = IN[0]

for i in range(len(IN[1])):
	result.insert(IN[1][i], True)
	
OUT = result
# ----------------------------------------
filterByBoolMask_4 = List.FilterByBoolMask(list=code_block_9, mask=python_script)

# group: Collect
code_block_15 = CodeBlock(foundations=all_elements_of_category_2, str_walls=filterByBoolMask.in, str_columns=all_elements_of_category_4, str_framing=all_elements_of_category_5, slabs=all_elements_of_category_6)
# ---------- code_block_15.designscript (7 lines) ----------
Structure = [
	foundations,
	str_walls,
	str_columns,
	str_framing,
	slabs
];
# ----------------------------------------
flatten_2 = List.Flatten(list=code_block_15)
code_block_16 = CodeBlock(roof=all_elements_of_category_7, nstr_ext_walls=filterByBoolMask_2.out, windows=all_elements_of_category_8, ext_doors=filterByBoolMask_4.out)
# ---------- code_block_16.designscript (6 lines) ----------
Skin = [
	roof,
	nstr_ext_walls,
	windows,
	ext_doors
];
# ----------------------------------------
flatten_3 = List.Flatten(list=code_block_16)
code_block_17 = CodeBlock(int_doors=filterByBoolMask_4.in, nstr_int_walls=filterByBoolMask_2.in, ceilings=all_elements_of_category_10, columns=all_elements_of_category_11)
# ---------- code_block_17.designscript (6 lines) ----------
SpacePlan = [
	int_doors,
	nstr_int_walls,
	ceilings,
	columns
];
# ----------------------------------------
flatten_4 = List.Flatten(list=code_block_17)

# group: Overwrite existing parameter values?
overwrite_existing_parameter = BoolSelector(false)  # "Overwrite existing parameter values?"; graph input

# group: Write the information in parameters
code_block_18 = CodeBlock(Structure=flatten_2, Skin=flatten_3, SpacePlan=flatten_4) { Site; Structure; Skin; Services; SpacePlan; Stuff; }  # unwired: Site, Services, Stuff
code_block_19 = CodeBlock { "Building layer"; }
code_block_20 = CodeBlock { Site = 0; Structure = 1; Skin = 2; Services = 3; SpacePlan = 4; Stuff = 5; }
getParameterValueByName_5 = Element.GetParameterValueByName(element=code_block_18.Structure, parameterName=code_block_19)
code_block_21 = CodeBlock(overwriteBL=overwrite_existing_parameter, default_value=code_block_20.Structure, parameter_value=getParameterValueByName_5) { overwriteBL; default_value; parameter_value; }
python_script_2 = Python(IN[0]=code_block_21.overwriteBL, IN[1]=code_block_21.default_value, IN[2]=code_block_21.parameter_value)  # CPython3
# ---------- python_script_2.python (13 lines) ----------
overwriteBL = IN[0]
default_value = IN[1]
parameter_value = IN[2]

OUT = []
for i in range(len(parameter_value)):
    if overwriteBL:
        OUT.append(default_value)
    else:
        if parameter_value[i] in [0,1,2,3,4,5]:
            OUT.append(parameter_value[i])
        else:
            OUT.append(default_value)
# ----------------------------------------
setParameterByName = Element.SetParameterByName(element=code_block_18.Structure, parameterName=code_block_19, value=python_script_2)
getParameterValueByName_6 = Element.GetParameterValueByName(element=code_block_18.Skin, parameterName=code_block_19)
code_block_22 = CodeBlock(overwriteBL=overwrite_existing_parameter, default_value=code_block_20.Skin, parameter_value=getParameterValueByName_6) { overwriteBL; default_value; parameter_value; }
python_script_3 = Python(IN[0]=code_block_22.overwriteBL, IN[1]=code_block_22.default_value, IN[2]=code_block_22.parameter_value)  # CPython3; same code as python_script_2
setParameterByName_2 = Element.SetParameterByName(element=code_block_18.Skin, parameterName=code_block_19, value=python_script_3)
getParameterValueByName_7 = Element.GetParameterValueByName(element=code_block_18.SpacePlan, parameterName=code_block_19)
code_block_23 = CodeBlock(overwriteBL=overwrite_existing_parameter, default_value=code_block_20.SpacePlan, parameter_value=getParameterValueByName_7) { overwriteBL; default_value; parameter_value; }
python_script_4 = Python(IN[0]=code_block_23.overwriteBL, IN[1]=code_block_23.default_value, IN[2]=code_block_23.parameter_value)  # CPython3; same code as python_script_2
setParameterByName_3 = Element.SetParameterByName(element=code_block_18.SpacePlan, parameterName=code_block_19, value=python_script_4)

# group: Color in view
list_create = List.Create(item0=setParameterByName, item1=setParameterByName_2, item2=setParameterByName_3)
flatten_5 = List.Flatten(list=list_create)
list_create_2 = List.Create(item0=python_script_2, item1=python_script_3, item2=python_script_4)
flatten_6 = List.Flatten(list=list_create_2)
code_block_24 = CodeBlock { [0,1,2,3,4,5]; }
contains = List.Contains(list=code_block_24, lacing=Longest)  # unwired: item
map = List.Map(list=flatten_6, function=contains)
filterByBoolMask_5 = List.FilterByBoolMask(list=flatten_5, mask=map)
code_block_25 = CodeBlock()
# ---------- code_block_25.designscript (7 lines) ----------
//Color.ByARGB(255, 0, 189, 124)
//Color.ByARGB(255, 255, 237, 0)
Color.ByARGB(255, 68, 68, 68);
Color.ByARGB(255, 236, 26, 146);
Color.ByARGB(255, 102, 204, 204);

Color.ByARGB(150, 242, 242, 242);
# ----------------------------------------
code_block_26 = CodeBlock { 1; }
eq_7 = _ == code_block_26  # unwired: x
replaceByCondition = Replace(item=flatten_6, replaceWith=code_block_25.out0, condition=eq_7)
code_block_27 = CodeBlock { 2; }
eq_8 = _ == code_block_27  # unwired: x
replaceByCondition_2 = Replace(item=replaceByCondition, replaceWith=code_block_25.out1, condition=eq_8)
code_block_28 = CodeBlock { 4; }
eq_9 = _ == code_block_28  # unwired: x
replaceByCondition_3 = Replace(item=replaceByCondition_2, replaceWith=code_block_25.out2, condition=eq_9)
code_block_29 = CodeBlock { 0; }
eq_10 = _ == code_block_29  # unwired: x
replaceByCondition_4 = Replace(item=replaceByCondition_3, replaceWith=code_block_25.out3, condition=eq_10)
code_block_30 = CodeBlock { 3; }
eq_11 = _ == code_block_30  # unwired: x
replaceByCondition_5 = Replace(item=replaceByCondition_4, replaceWith=code_block_25.out3, condition=eq_11)
code_block_31 = CodeBlock { 5; }
eq_12 = _ == code_block_31  # unwired: x
replaceByCondition_6 = Replace(item=replaceByCondition_5, replaceWith=code_block_25.out3, condition=eq_12)
filterByBoolMask_6 = List.FilterByBoolMask(list=replaceByCondition_6, mask=map)
code_block_32 = CodeBlock(c=filterByBoolMask_6.in) { Color.Red(c)-50; Color.Green(c)-26; Color.Blue(c)-50; }
byARGB = Color.ByARGB(r=code_block_32.out0, g=code_block_32.out1, b=code_block_32.out2)
code_block_33 = CodeBlock { "<Solid fill>"; }
getByName = FillPatternElement.GetByName(name=code_block_33)
byProperties = Revit.Filter.OverrideGraphicSettings.ByProperties(projectionFillColor=filterByBoolMask_6.in, projectionLineColor=byARGB, projectionFillPattern=getByName)

# group: Veify if color is needed
code_block_34 = CodeBlock(elements=filterByBoolMask_5.in) { elements; }
empty = List.Empty()
preview_colored_elements_after = BoolSelector(true)  # "Preview colored elements after assigning layer?"; graph input
code_block_35 = CodeBlock(trueval=code_block_34, falseval=empty, test=preview_colored_elements_after) { result = [trueval, falseval]; result[test ? 0 : 1]; }

# group (continued): Color in view
overrideInView = Element.OverrideInView(element=code_block_35.out1, overrides=byProperties)

# group: Take all other elements from the view
id = Element.Id(element=filterByBoolMask_5.in)
all_elements_in_active_view = ElementsInView()
id_2 = Element.Id(element=all_elements_in_active_view)
python_script_5 = Python(IN[0]=id, IN[1]=id_2)  # CPython3
# ---------- python_script_5.python (13 lines) ----------
# Load the Python Standard and DesignScript Libraries
import sys
import clr
clr.AddReference('ProtoGeometry')
from Autodesk.DesignScript.Geometry import *

list_A = IN[0]
list_B = IN[1]

common = set(list_B).intersection(list_A)
difference = set(list_B) - set(list_A)

OUT = [common, difference]
# ----------------------------------------
code_block_36 = CodeBlock(seq=python_script_5) { common = seq[0]; difference = seq[1]; }
element_by_id = ElementById(Id=code_block_36.difference)

# group: Veify if color is needed
empty_2 = List.Empty()
code_block_37 = CodeBlock(trueval=element_by_id, falseval=empty_2, test=preview_colored_elements_after) { result = [trueval, falseval]; result[test ? 0 : 1]; }

# group: Color all unwanted elements gray and transparent.
code_block_38 = CodeBlock(elements=code_block_37.out1) { elements; }
code_block_39 = CodeBlock { 100; }
byARGB_2 = Color.ByARGB(r=code_block_39, g=code_block_39, b=code_block_39)
code_block_40 = CodeBlock { 150; }
byARGB_3 = Color.ByARGB(r=code_block_40, g=code_block_40, b=code_block_40)
code_block_41 = CodeBlock { 80; }
byProperties_2 = Revit.Filter.OverrideGraphicSettings.ByProperties(projectionFillColor=byARGB_2, projectionLineColor=byARGB_3, projectionFillPattern=getByName, transparency=code_block_41)
overrideInView_2 = Element.OverrideInView(element=code_block_38, overrides=byProperties_2)
