# Dynamo graph 1_MeasureCircularity.dyn (Dynamo 2.10.1.3976)

# group: READ ME
# note: TBC...

# group: Check geometrical volume
code_block = CodeBlock { elem; }  # frozen; unwired: elem
code_block_2 = CodeBlock { "Volume"; }
getParameterValueByName = Element.GetParameterValueByName(element=code_block, parameterName=code_block_2)
sum = Math.Sum(values=getParameterValueByName)
sum_2 = Math.Sum(values=sum)
watch = Watch(sum_2)
geometry = Element.Geometry(element=code_block)  # frozen
flatten = List.Flatten(list=geometry)
volume = Solid.Volume(solid=flatten)
sum_3 = Math.Sum(values=volume)
code_block_3 = CodeBlock(x=sum_3) { x/1000000000; }
watch_2 = Watch(code_block_3)

# group: Get elements from groups
categories = Categories("OST_IOSModelGroups")  # frozen
all_elements_of_category = ElementsOfCategory(Category=categories)
getMembers = Group.GetMembers(group=all_elements_of_category)
flatten_2 = List.Flatten(list=getMembers)
uniqueItems = List.UniqueItems(list=flatten_2)

# group: Collect all elements
code_block_4 = CodeBlock()
# ---------- code_block_4.designscript (12 lines) ----------
[
"Doors",
"Windows",
"Floors",
"Structural Columns",
"Structural Framing",
"Walls",
"Ceilings",
"Columns",
"Roofs",
"Structural Foundations"
];
# ----------------------------------------
include_the_foundations = BoolSelector(false)  # graph input
code_block_5 = CodeBlock { 9; -1; }
if_ = If(test=include_the_foundations, true=code_block_5.out1, false=code_block_5.out0)
removeItemAtIndex = List.RemoveItemAtIndex(list=code_block_4, indices=if_)
byName = Category.ByName(name=removeItemAtIndex)
all_elements_of_category_2 = ElementsOfCategory(Category=byName)
flatten_3 = List.Flatten(list=all_elements_of_category_2)

# group: Collect materials
getMaterials = Element.GetMaterials(element=flatten_3)
name = Material.Name(material=getMaterials)
string_from_array = FromArray()  # unwired: arr
map = List.Map(list=name, f_x=string_from_array)
code_block_6 = CodeBlock(str=map) { x1 = String.Replace(str,"[",""); x2 = String.Replace(x1,"]",""); x3 = String.Replace(x2,",",", "); }
code_block_7 = CodeBlock(materials=code_block_6.x3) { materials; }

# group: Take internal unit of measure ID
unit_types = UnitTypes("Area")
py_revit_version = Python()  # IronPython2
# ---------- py_revit_version.python (12 lines) ----------
import clr
clr.AddReference("RevitServices")
import RevitServices
from RevitServices.Persistence import DocumentManager

doc = DocumentManager.Instance.CurrentDBDocument
uiapp = DocumentManager.Instance.CurrentUIApplication
app = uiapp.Application
if int(app.VersionNumber) > 2017: fullVersion = app.SubVersionNumber
else: fullVersion = str(app.VersionNumber)

OUT = app.VersionName, int(app.VersionNumber), app.VersionBuild, app.Language.ToString(), fullVersion
# ----------------------------------------
code_block_8 = CodeBlock(seq=py_revit_version) { version = seq[1]; }
python_script = Python(IN[0]=unit_types, IN[1]=code_block_8)  # IronPython2
# ---------- python_script.python (43 lines) ----------
import clr
clr.AddReference('RevitAPI')
from Autodesk.Revit.DB import *

clr.AddReference("RevitServices")
import RevitServices
from RevitServices.Persistence import DocumentManager
doc = DocumentManager.Instance.CurrentDBDocument

dynunittype = IN[0]
if IN[1] > 2021:
	if str(dynunittype.GetType()) == "Autodesk.Revit.DB.ForgeTypeId":
		unittype = dynunittype
	elif str(dynunittype) == 'DynamoUnits.Area':
		unittype = ForgeTypeId('autodesk.spec.aec:area-2.0.0')
	elif str(dynunittype) == 'DynamoUnits.Length':
		unittype = ForgeTypeId('autodesk.spec.aec:length-2.0.0')
	elif str(dynunittype) == 'DynamoUnits.Volume':
		unittype = ForgeTypeId('autodesk.spec.aec:volume-2.0.0')
	else:
		unittype = None
	formatoptions = doc.GetUnits().GetFormatOptions(unittype)
	dispunits = formatoptions.GetUnitTypeId()
	symtype = formatoptions.GetSymbolTypeId()
	if symtype.TypeId == '': dispsym = None
	else: dispsym = LabelUtils.GetLabelForSymbol(symtype)
else:
	if str(dynunittype.GetType()) == "Autodesk.Revit.DB.UnitType":
		unittype = dynunittype
	elif str(dynunittype) == 'DynamoUnits.Area':
		unittype = UnitType.UT_Area
	elif str(dynunittype) == 'DynamoUnits.Length':
		unittype = UnitType.UT_Length
	elif str(dynunittype) == 'DynamoUnits.Volume':
		unittype = UnitType.UT_Volume
	else:
		unittype = None
	formatoptions = doc.GetUnits().GetFormatOptions(unittype)
	dispunits = formatoptions.DisplayUnits
	symtype = formatoptions.UnitSymbol
	if symtype == UnitSymbolType.UST_NONE: dispsym = None
	else: dispsym = LabelUtils.GetLabelFor(symtype)
OUT = (dispunits,dispsym)
# ----------------------------------------
code_block_9 = CodeBlock(seq=python_script) { displayUnitType = seq[0]; unitSymbol = seq[1]; }
unit_types_2 = UnitTypes("Volume")
python_script_2 = Python(IN[0]=unit_types_2, IN[1]=code_block_8)  # IronPython2; same code as python_script
code_block_10 = CodeBlock(seq=python_script_2) { displayUnitType = seq[0]; unitSymbol = seq[1]; }

# group: Collect info about materials (layers)
code_block_11 = CodeBlock(elem=flatten_3) { elem; }
turn_into_list = CodeBlock(x=code_block_11) { List.Flatten([x]); }
returnPaintMaterials = BoolSelector(false)
py_material_clockwork = Python(IN[0]=turn_into_list, IN[1]=returnPaintMaterials)  # IronPython2
# ---------- py_material_clockwork.python (22 lines) ----------
import clr
clr.AddReference('RevitAPI')
from Autodesk.Revit.DB import *

items = UnwrapElement(IN[0])
paintedmats = IN[1]
elementmats = list()
elementareas = list()
elementvols = list()

for item in items:
	matlist = list()
	arealist = list()
	vollist = list()
	for matid in item.GetMaterialIds(paintedmats):
		matlist.append(item.Document.GetElement(matid))
		arealist.append(item.GetMaterialArea(matid,paintedmats))
		vollist.append(item.GetMaterialVolume(matid))
	elementmats.append(matlist)
	elementareas.append(arealist)
	elementvols.append(vollist)
OUT = (elementmats,elementareas,elementvols)
# ----------------------------------------
code_block_12 = CodeBlock(seq=py_material_clockwork) { seq[0]; seq[1]; seq[2]; }
isEmpty = List.IsEmpty()  # unwired: list
map_2 = List.Map(list=code_block_12.out0, function=isEmpty)
not_ = Not(x=map_2)
py_returnlistorsinglevalue = Python(IN[0]=code_block_11, IN[1]=not_)  # IronPython2
# ---------- py_returnlistorsinglevalue.python (4 lines) ----------
check = IN[0]
items = IN[1]
if isinstance(check, (list)): OUT = items
else: OUT = items[0]
# ----------------------------------------
code_block_13 = CodeBlock(hasMaterial=py_returnlistorsinglevalue) { hasMaterial; }
code_block_14 = CodeBlock(value=code_block_12.out1, displayUnitType=code_block_9.displayUnitType, RevitVersion=code_block_8) { value; displayUnitType; RevitVersion; }
py_internalunit_todisplayunit = Python(IN[0]=code_block_14.value, IN[1]=code_block_14.displayUnitType, IN[2]=code_block_14.RevitVersion)  # "Py InternalUnit.ToDisplayUnit (Clockwork)"; IronPython2
# ---------- py_internalunit_todisplayunit.python (26 lines) ----------
import clr
clr.AddReference('RevitAPI')
from Autodesk.Revit.DB import *

def FromInternalUnits(val, unittype):
	if (version > 2021 and str(dispunit.GetType()) == "Autodesk.Revit.DB.ForgeTypeId") or (version < 2022 and str(dispunit.GetType()) == "Autodesk.Revit.DB.DisplayUnitType"):
		return UnitUtils.ConvertFromInternalUnits(val,unittype)
	else: return None

vals = IN[0]
dispunit = IN[1]
version = IN[2]

# turn into list of lists:
if not isinstance(vals[0], list):
    vals = [vals]
if not isinstance(vals[0], list):
    vals = [vals]

OUT = []

for list in vals:
	inner = []
	for x in list:
		inner.append(FromInternalUnits(x, dispunit))
	OUT.append(inner)
# ----------------------------------------
py_returnlistorsinglevalue_2 = Python(IN[0]=code_block_11, IN[1]=py_internalunit_todisplayunit)  # IronPython2; same code as py_returnlistorsinglevalue
code_block_15 = CodeBlock(materialAreas=py_returnlistorsinglevalue_2) { materialAreas; }
py_returnlistorsinglevalue_3 = Python(IN[0]=code_block_11, IN[1]=code_block_12.out0)  # IronPython2; same code as py_returnlistorsinglevalue
code_block_16 = CodeBlock(materials=py_returnlistorsinglevalue_3) { materials; }
name_2 = Material.Name(material=code_block_16)
code_block_17 = CodeBlock(value=code_block_12.out2, displayUnitType=code_block_10.displayUnitType, RevitVersion=code_block_8) { value; displayUnitType; RevitVersion; }
py_internalunit_todisplayunit_2 = Python(IN[0]=code_block_17.value, IN[1]=code_block_17.displayUnitType, IN[2]=code_block_17.RevitVersion)  # "Py InternalUnit.ToDisplayUnit (Clockwork)"; IronPython2; same code as py_internalunit_todisplayunit
py_returnlistorsinglevalue_4 = Python(IN[0]=code_block_11, IN[1]=py_internalunit_todisplayunit_2)  # IronPython2; same code as py_returnlistorsinglevalue
code_block_18 = CodeBlock(materialVolumes=py_returnlistorsinglevalue_4) { materialVolumes; }

code_block_19 = CodeBlock(materialAreas=code_block_15) { materialAreas; }

# group: Match materials
string = StringInput(".\snippets\Map_names.py")
file_from_path = FileObject(path=string)
readText = FileSystem.ReadText(file=file_from_path)
string_2 = StringInput(".\data\Material_mapping.json")
file_from_path_2 = FileObject(path=string_2)
readText_2 = FileSystem.ReadText(file=file_from_path_2)
code_block_20 = CodeBlock(materials=name_2) { materials; }
watch_3 = Watch(code_block_20)
py_match_material_names = PythonStringNode(script=readText, IN[0]=readText_2, IN[1]=watch_3)  # CPython3
watch_4 = Watch(py_match_material_names)

code_block_21 = CodeBlock(materialVolumes=code_block_18) { materialVolumes; }

# group: Split RC into steel and concrete (using constant ratio)
code_block_22 = CodeBlock(materials=watch_4, volumes=code_block_21) { materials; volumes; steel_concrete_ratio = 0.025; }
python_script_3 = Python(IN[0]=code_block_22.materials, IN[1]=code_block_22.volumes, IN[2]=code_block_22.steel_concrete_ratio)  # CPython3
# ---------- python_script_3.python (26 lines) ----------
# Load the Python Standard and DesignScript Libraries
import sys
import clr
clr.AddReference('ProtoGeometry')
from Autodesk.DesignScript.Geometry import *
from copy import deepcopy

materials = IN[0]
volumes = IN[1]
steel_concrete_ratio = IN[2]

new_materials = deepcopy(materials)
new_volumes = deepcopy(volumes)

for i in range(len(materials)):
    for j in range(len(materials[i])):
        if materials[i][j] == "Concrete":
            new_volumes[i][j] = volumes[i][j] * (1-steel_concrete_ratio)
            if "Steel" in materials[i]:
                steel_id = materials[i].index("Steel")
                new_volumes[i][steel_id] = volumes[i][j]*steel_concrete_ratio
            else:
                new_materials[i].append("Steel")
                new_volumes[i].append(volumes[i][j]*steel_concrete_ratio)

OUT = [new_materials, new_volumes, volumes[i][j]]
# ----------------------------------------
code_block_23 = CodeBlock(seq=python_script_3) { materials = seq[0]; volumes = seq[1]; }

watch_5 = Watch(code_block_23.materials)
watch_6 = Watch(code_block_23.volumes)

# group: Filter by volume
code_block_24 = CodeBlock(material_name=watch_5, material_volume=watch_6) { material_name; material_volume; }
sum_4 = Math.Sum(values=code_block_24.material_volume)
code_block_25 = CodeBlock { 0; }
eq = Equals(x=sum_4, y=code_block_25)
filterByBoolMask = List.FilterByBoolMask(list=code_block_24.material_volume, mask=eq)
flatten_4 = List.Flatten(list=filterByBoolMask.out)
filterByBoolMask_2 = List.FilterByBoolMask(list=code_block_24.material_name, mask=eq)
flatten_5 = List.Flatten(list=filterByBoolMask_2.out)
count = List.Count(list=filterByBoolMask_2.out, lacing=Longest)
code_block_26 = CodeBlock(elements=flatten_3) { elements; }
filterByBoolMask_3 = List.FilterByBoolMask(list=code_block_26, mask=eq)

# group: Load input data
string_3 = StringInput(".\data\Material_data.json")
file_from_path_3 = FileObject(path=string_3)
readText_3 = FileSystem.ReadText(file=file_from_path_3)
parseJSON = Data.ParseJSON(json=readText_3)
watch_7 = Watch(parseJSON)

# group: Circularity Calculations
code_block_27 = CodeBlock()
# ---------- code_block_27.designscript (2 lines) ----------
//Product utility
X=1;
# ----------------------------------------
code_block_28 = CodeBlock(volume=flatten_4) { volume; }
code_block_29 = CodeBlock(data=watch_7, material=flatten_5)
# ---------- code_block_29.designscript (19 lines) ----------
Dictionary.ValueAtKey(Dictionary.ValueAtKey(data, material), "CR");
Dictionary.ValueAtKey(Dictionary.ValueAtKey(data, material), "CU");
Dictionary.ValueAtKey(Dictionary.ValueAtKey(data, material), "CC");

Dictionary.ValueAtKey(Dictionary.ValueAtKey(data, material), "ER");
Dictionary.ValueAtKey(Dictionary.ValueAtKey(data, material), "HHV");
Dictionary.ValueAtKey(Dictionary.ValueAtKey(data, material), "MB");

Dictionary.ValueAtKey(Dictionary.ValueAtKey(data, material), "BC");

Dictionary.ValueAtKey(Dictionary.ValueAtKey(data, material), "F");
Dictionary.ValueAtKey(Dictionary.ValueAtKey(data, material), "E");
Dictionary.ValueAtKey(Dictionary.ValueAtKey(data, material), "EC");

Dictionary.ValueAtKey(Dictionary.ValueAtKey(data, material), "Density");

Dictionary.ValueAtKey(Dictionary.ValueAtKey(data, material), "Fr");
Dictionary.ValueAtKey(Dictionary.ValueAtKey(data, material), "Fu");
Dictionary.ValueAtKey(Dictionary.ValueAtKey(data, material), "Fs");
# ----------------------------------------
code_block_30 = CodeBlock(volume=code_block_28, density=code_block_29.out10)
# ---------- code_block_30.designscript (2 lines) ----------
//Mass
M=volume*density;
# ----------------------------------------
code_block_31 = CodeBlock(M=code_block_30, Fr=code_block_29.out11, Fu=code_block_29.out12, Fs=code_block_29.out13)
# ---------- code_block_31.designscript (2 lines) ----------
//Amount of virgin material
V = M*(1-Fr-Fu-Fs);
# ----------------------------------------
code_block_32 = CodeBlock(ER=code_block_29.out3, HHV=code_block_29.out4, MB=code_block_29.out5)
# ---------- code_block_32.designscript (2 lines) ----------
//efficiency of the energy recovery process
EE = ER+HHV*MB;
# ----------------------------------------
code_block_33 = CodeBlock(EE=code_block_32, BC=code_block_29.out6)
# ---------- code_block_33.designscript (4 lines) ----------
//Fraction of mass of a product being collected
//for energy recovery where the material
//satisfies the requirements for inclusion
CE = EE*BC;
# ----------------------------------------
code_block_34 = CodeBlock(M=code_block_30, CR=code_block_29.out0, CU=code_block_29.out1, CC=code_block_29.out2, CE=code_block_33)
# ---------- code_block_34.designscript (2 lines) ----------
//Waste from the linear flow Wj
W0 = M*(1-CR-CU-CC-CE);
# ----------------------------------------
code_block_35 = CodeBlock(M=code_block_30, F=code_block_29.out7, E=code_block_29.out8)
# ---------- code_block_35.designscript (3 lines) ----------
//Waste to produce any recycled content used
//as feedstock in the  recycling process Wj
WF = M*F*(1-E)/E;
# ----------------------------------------
code_block_36 = CodeBlock(M=code_block_30, EC=code_block_29.out9, CR=code_block_29.out0)
# ---------- code_block_36.designscript (2 lines) ----------
//Waste generated in the  recycling process Wj
WC = M*(1-EC)*CR;
# ----------------------------------------
code_block_37 = CodeBlock(W0=code_block_34, WF=code_block_35, WC=code_block_36)
# ---------- code_block_37.designscript (2 lines) ----------
//Amount of unrecoverable waste
W = W0+(WF+WC)/2;
# ----------------------------------------
code_block_38 = CodeBlock(V=code_block_31, W=code_block_37, M=code_block_30)
# ---------- code_block_38.designscript (2 lines) ----------
//Linear Flow Index
LFI = (V+W)/(2*M);
# ----------------------------------------
code_block_39 = CodeBlock(X=code_block_27, LFI=code_block_38)
# ---------- code_block_39.designscript (2 lines) ----------
//Material Circularity Indicator
MCI = 1-(0.9/X*LFI);
# ----------------------------------------
code_block_40 = CodeBlock { 0; }
ge = code_block_39 >= code_block_40
if_2 = If(test=ge, true=code_block_39, false=code_block_40)
code_block_41 = CodeBlock()
# ---------- code_block_41.designscript (2 lines) ----------
//Disassembly index
DI=0.175;
# ----------------------------------------
code_block_42 = CodeBlock(MCI=if_2, DI=code_block_41)
# ---------- code_block_42.designscript (2 lines) ----------
//Product Circularity Indicator
PCI = MCI/DI;
# ----------------------------------------
code_block_43 = CodeBlock(PCI=code_block_42, Mj=code_block_30) { PCI*Mj; }
code_block_44 = CodeBlock(count=count) { count; }
chop = List.Chop(list=code_block_43, lengths=code_block_44)
sum_5 = Math.Sum(values=chop)
chop_2 = List.Chop(list=code_block_30, lengths=code_block_44)
sum_6 = Math.Sum(values=chop_2)
code_block_45 = CodeBlock(x=sum_5, Ms=sum_6)
# ---------- code_block_45.designscript (3 lines) ----------
//System Circularity Indicator
// SCI = PCI*Mj/Ms;
SCI = x/Ms;
# ----------------------------------------
code_block_46 = CodeBlock()
# ---------- code_block_46.designscript (2 lines) ----------
//Building Layer
BL=0.1;
# ----------------------------------------
code_block_47 = CodeBlock(SCI=code_block_45, BL=code_block_46)
# ---------- code_block_47.designscript (3 lines) ----------
//Building Circularity Indicator
LK = 0.1+0.2+0.7+0.8+0.9+1.0;
BCI = Math.Sum(SCI*BL)/LK;
# ----------------------------------------
code_block_48 = CodeBlock(MCI=if_2, PCI=code_block_42, SCI=code_block_45, BCI=code_block_47.BCI) { MCI; PCI; SCI; BCI; }

# group: Save results to parameter
code_block_49 = CodeBlock { "Material Circularity Indicator"; }
code_block_50 = CodeBlock(MCI=code_block_48.MCI, PCI=code_block_48.PCI, SCI=code_block_48.SCI, BCI=code_block_48.BCI) { MCI; PCI; SCI; BCI; }
setParameterByName = Element.SetParameterByName(parameterName=code_block_49, value=code_block_50.MCI)  # frozen; unwired: element
code_block_51 = CodeBlock { "Product Circularity Indicator"; }
setParameterByName_2 = Element.SetParameterByName(parameterName=code_block_51, value=code_block_50.PCI)  # frozen; unwired: element
code_block_52 = CodeBlock(elements=filterByBoolMask_3.out) { elements; }
code_block_53 = CodeBlock { "System Circularity Indicator"; }
setParameterByName_3 = Element.SetParameterByName(element=code_block_52, parameterName=code_block_53, value=code_block_50.SCI)
categories_2 = Categories("OST_ProjectInformation")
all_elements_of_category_3 = ElementsOfCategory(Category=categories_2)
code_block_54 = CodeBlock { "Building Circularity Indicator"; }
setParameterByName_4 = Element.SetParameterByName(element=all_elements_of_category_3, parameterName=code_block_54, value=code_block_50.BCI)

# group: Collect parameters
code_block_55 = CodeBlock(elem=flatten_3) { elem; }
id = Element.Id(element=code_block_55)
getCategory = Element.GetCategory(element=code_block_55)
string_from_object = FromObject(object=getCategory)
list_create = List.Create(item0=code_block_55, item1=id, item2=string_from_object)
code_block_56 = CodeBlock { "Area"; }
getParameterValueByName_2 = Element.GetParameterValueByName(element=code_block_55, parameterName=code_block_56, lacing=CrossProduct)
code_block_57 = CodeBlock { "Volume"; }
getParameterValueByName_3 = Element.GetParameterValueByName(element=code_block_55, parameterName=code_block_57, lacing=CrossProduct)
list_create_2 = List.Create(item0=getParameterValueByName_2, item1=getParameterValueByName_3)
code_block_58 = CodeBlock { "Type"; }
getParameterValueByName_4 = Element.GetParameterValueByName(element=code_block_55, parameterName=code_block_58, lacing=Longest)
code_block_59 = CodeBlock()
# ---------- code_block_59.designscript (3 lines) ----------
[
"Type Name"
];
# ----------------------------------------
getParameterValueByName_5 = Element.GetParameterValueByName(element=getParameterValueByName_4, parameterName=code_block_59, lacing=CrossProduct)
transpose = List.Transpose(lists=getParameterValueByName_5)
join = List.Join(list0=list_create, list1=list_create_2, list2=transpose)
transpose_2 = List.Transpose(lists=join)
watch_8 = Watch(transpose_2)

# group: Circularity calculations (Python placeholder)
string_4 = StringInput(".\snippets\Circularity_indicator.py")
file_from_path_4 = FileObject(path=string_4)
readText_4 = FileSystem.ReadText(file=file_from_path_4)
watch_9 = Watch(watch_8)  # frozen
py_circularity_indicator_calcs = PythonStringNode(script=readText_4, IN[0]=watch_9)  # IronPython2
watch_10 = Watch(py_circularity_indicator_calcs)

string_5 = StringInput(".\data\Lifespan_expectancy.json")
file_from_path_5 = FileObject(path=string_5)
readText_5 = FileSystem.ReadText(file=file_from_path_5)

# group: Circularity results
average = Math.Average(numbers=code_block_50.SCI)
code_block_60 = CodeBlock(x=average) { "Your average System Circularity Indicator is: "+x+"."; }
system_circularity_indicator = Watch(code_block_60)  # "System Circularity Indicator score"; graph output
code_block_61 = CodeBlock(x=code_block_50.BCI) { "Your Building Circularity Indicator is: "+x+"."; }
building_circularity_indicator = Watch(code_block_61)  # "Building Circularity Indicator score"; graph output

code_block_62 = CodeBlock { "Placeholder"; }  # frozen
removeKeys = DesignScript.Builtin.Dictionary.RemoveKeys(dictionary=watch_7, keys=code_block_62)
keys = DesignScript.Builtin.Dictionary.Keys(dictionary=removeKeys)

# group: TODO
code_block_63 = CodeBlock()  # // Compute volumes for non volumetric elements (now foundations fail!)
