# Dynamo graph 2_GenerateReport.dyn (Dynamo 2.10.1.3976)

# group: READ ME
# note: TBC...

# group: Collect all elements
code_block = CodeBlock()
# ---------- code_block.designscript (11 lines) ----------
[
"Doors",
"Windows",
"Floors",
"Structural Columns",
"Structural Framing",
"Walls",
"Ceilings",
"Columns",
"Structural Foundations"
];
# ----------------------------------------
include_the_foundations = BoolSelector(false)  # graph input
code_block_2 = CodeBlock { 8; -1; }
if_ = If(test=include_the_foundations, true=code_block_2.out0, false=code_block_2.out1)
removeItemAtIndex = List.RemoveItemAtIndex(list=code_block, indices=if_)
byName = Category.ByName(name=removeItemAtIndex)
all_elements_of_category = ElementsOfCategory(Category=byName)
flatten = List.Flatten(list=all_elements_of_category)

# group: Collect parameters
code_block_3 = CodeBlock()
# ---------- code_block_3.designscript (4 lines) ----------
[
"Id",
"Category"
];
# ----------------------------------------
code_block_4 = CodeBlock()
# ---------- code_block_4.designscript (7 lines) ----------
[
"Area",
"Volume",
"Product Circularity Indicator"
];
//"Length",
//"Thickness",
# ----------------------------------------
code_block_5 = CodeBlock()
# ---------- code_block_5.designscript (3 lines) ----------
[
"Type Name"
];
# ----------------------------------------
join = List.Join(list0=code_block_3, list1=code_block_4, list2=code_block_5)
code_block_6 = CodeBlock(elem=flatten) { elem; }
id = Element.Id(element=code_block_6)
getCategory = Element.GetCategory(element=code_block_6)
string_from_object = FromObject(obj=getCategory)
list_create = List.Create(item0=id, item1=string_from_object)
getParameterValueByName = Element.GetParameterValueByName(element=code_block_6, parameterName=code_block_4, lacing=CrossProduct)
transpose = List.Transpose(lists=getParameterValueByName)
code_block_7 = CodeBlock { "Type"; }
getParameterValueByName_2 = Element.GetParameterValueByName(element=code_block_6, parameterName=code_block_7, lacing=Longest)
getParameterValueByName_3 = Element.GetParameterValueByName(element=getParameterValueByName_2, parameterName=code_block_5, lacing=CrossProduct)
transpose_2 = List.Transpose(lists=getParameterValueByName_3)
join_2 = List.Join(list0=list_create, list1=transpose, list2=transpose_2)

# group: Combine and add headers
addItemToEnd = List.AddItemToEnd(list=join)  # frozen; unwired: item
transpose_3 = List.Transpose(lists=join_2)
addItemToFront = List.AddItemToFront(item=addItemToEnd, list=transpose_3)
addItemToEnd_2 = List.AddItemToEnd(list=join_2)  # unwired: item

# group: Check geometrical volume
code_block_8 = CodeBlock { elem; }  # frozen; unwired: elem
code_block_9 = CodeBlock { "Volume"; }
getParameterValueByName_4 = Element.GetParameterValueByName(element=code_block_8, parameterName=code_block_9)
sum = Math.Sum(values=getParameterValueByName_4)
sum_2 = Math.Sum(values=sum)
watch = Watch(sum_2)
geometry = Element.Geometry(element=code_block_8)  # frozen
flatten_2 = List.Flatten(list=geometry)
volume = Solid.Volume(solid=flatten_2)
sum_3 = Math.Sum(values=volume)
code_block_10 = CodeBlock(x=sum_3) { x/1000000000; }
watch_2 = Watch(code_block_10)

# group: Get elements from groups
categories = Categories("OST_IOSModelGroups")  # frozen
all_elements_of_category_2 = ElementsOfCategory(Category=categories)
getMembers = Group.GetMembers(group=all_elements_of_category_2)
flatten_3 = List.Flatten(list=getMembers)
uniqueItems = List.UniqueItems(list=flatten_3)

excel_template_file_location = StringInput(".\template\Template_Excel_report.xlsx")
file_from_path = FileObject(path=excel_template_file_location)
excel_report_directory_path = Directory("C:\Users\arturbt\Desktop\Temp")  # graph input
string = StringInput("\")
excel_report_file_name = StringInput("testest")  # graph input
string_2 = StringInput(".xlsx")
concat = String.Concat(string0=excel_report_directory_path, string1=string, string2=excel_report_file_name, string3=string_2)
boolean = BoolSelector(true)
copyFile = FileSystem.CopyFile(file=file_from_path, destinationPath=concat, overwrite=boolean)
if_2 = If(test=copyFile, true=concat, false=concat)

# group: Export to Excel
string_3 = StringInput("Revit_data")
code_block_11 = CodeBlock { 1; 0; }
code_block_12 = CodeBlock(data=transpose_3) { data; }
boolean_2 = BoolSelector(false)
exportExcel = Data.ExportExcel(filePath=if_2, sheetName=string_3, startRow=code_block_11.out0, startCol=code_block_11.out1, data=code_block_12, overWrite=boolean_2)
exportToExcel = Data.ExportToExcel(filePath=if_2, sheetName=string_3, startRow=code_block_11.out0, startColumn=code_block_11.out1, data=code_block_12, overWrite=boolean_2)  # frozen

# group: Info display
isEmpty = List.IsEmpty(list=exportExcel)
code_block_13 = CodeBlock(path=if_2) { "You're data was succesfully exported to Excel: "+path; "There was a problem exporting your Excel data."; }
if_3 = If(test=isEmpty, true=code_block_13.out1, false=code_block_13.out0)
export_result = Watch(if_3)  # graph output
