# Dynamo graph 2_MeasureCircularity.dyn (Dynamo 2.10.1.3976)

# group: READ ME
# note: TBC...

# group: Get elements from groups
categories = Categories("OST_IOSModelGroups")  # frozen
all_elements_of_category = ElementsOfCategory(Category=categories)
getMembers = Group.GetMembers(group=all_elements_of_category)
flatten = List.Flatten(list=getMembers)
uniqueItems = List.UniqueItems(list=flatten)

# group: Collect all elements
code_block = CodeBlock()
# ---------- code_block.designscript (12 lines) ----------
[
"Doors",
"Windows",
"Floors",
"Structural Columns",
"Structural Framing",
"Walls",
"Ceilings",
"Columns",
"Roofs",
"Structural Foundations"
];
# ----------------------------------------
code_block_2 = CodeBlock { 9; -1; }
include_the_foundations = BoolSelector(true)  # graph input
code_block_3 = CodeBlock(trueval=code_block_2.out1, falseval=code_block_2.out0, test=include_the_foundations) { result = [trueval, falseval]; result[test ? 0 : 1]; }
removeItemAtIndex = List.RemoveItemAtIndex(list=code_block, indices=code_block_3.out1)
byName = Category.ByName(name=removeItemAtIndex)
all_elements_of_category_2 = ElementsOfCategory(Category=byName)
flatten_2 = List.Flatten(list=all_elements_of_category_2)
code_block_4 = CodeBlock { 9; -1; }

# group: Take internal unit of measure ID
unit_types = UnitTypes("Area")
py_revit_version = Python()  # CPython3
# ---------- py_revit_version.python (12 lines) ----------
import clr
clr.AddReference("RevitServices")
import RevitServices
from RevitServices.Persistence import DocumentManager

doc = DocumentManager.Instance.CurrentDBDocument
uiapp = DocumentManager.Instance.CurrentUIApplication
app = uiapp.Application
if int(app.VersionNumber) > 2017: fullVersion = app.SubVersionNumber
else: fullVersion = str(app.VersionNumber)

OUT = app.VersionName, int(app.VersionNumber), app.VersionBuild, fullVersion # app.Language.ToString()
# ----------------------------------------
code_block_5 = CodeBlock(OUT=py_revit_version) { version = OUT[1]; }
python_script = Python(IN[0]=unit_types, IN[1]=code_block_5)  # CPython3
# ---------- python_script.python (43 lines) ----------
import clr
clr.AddReference('RevitAPI')
from Autodesk.Revit.DB import *

clr.AddReference("RevitServices")
import RevitServices
from RevitServices.Persistence import DocumentManager
doc = DocumentManager.Instance.CurrentDBDocument

dynunittype = IN[0]
if IN[1] > 2021:
	if str(dynunittype.GetType()) == "Autodesk.Revit.DB.ForgeTypeId":
		unittype = dynunittype
	elif str(dynunittype) == 'DynamoUnits.Area':
		unittype = ForgeTypeId('autodesk.spec.aec:area-2.0.0')
	elif str(dynunittype) == 'DynamoUnits.Length':
		unittype = ForgeTypeId('autodesk.spec.aec:length-2.0.0')
	elif str(dynunittype) == 'DynamoUnits.Volume':
		unittype = ForgeTypeId('autodesk.spec.aec:volume-2.0.0')
	else:
		unittype = None
	formatoptions = doc.GetUnits().GetFormatOptions(unittype)
	dispunits = formatoptions.GetUnitTypeId()
	symtype = formatoptions.GetSymbolTypeId()
	if symtype.TypeId == '': dispsym = None
	else: dispsym = LabelUtils.GetLabelForSymbol(symtype)
else:
	if str(dynunittype.GetType()) == "Autodesk.Revit.DB.UnitType":
		unittype = dynunittype
	elif str(dynunittype) == 'DynamoUnits.Area':
		unittype = UnitType.UT_Area
	elif str(dynunittype) == 'DynamoUnits.Length':
		unittype = UnitType.UT_Length
	elif str(dynunittype) == 'DynamoUnits.Volume':
		unittype = UnitType.UT_Volume
	else:
		unittype = None
	formatoptions = doc.GetUnits().GetFormatOptions(unittype)
	dispunits = formatoptions.DisplayUnits
	symtype = formatoptions.UnitSymbol
	if symtype == UnitSymbolType.UST_NONE: dispsym = None
	else: dispsym = LabelUtils.GetLabelFor(symtype)
OUT = (dispunits,dispsym)
# ----------------------------------------
code_block_6 = CodeBlock(OUT=python_script) { displayUnitType = OUT[0]; unitSymbol = OUT[1]; }
unit_types_2 = UnitTypes("Volume")
python_script_2 = Python(IN[0]=unit_types_2, IN[1]=code_block_5)  # CPython3; same code as python_script
code_block_7 = CodeBlock(OUT=python_script_2) { displayUnitType = OUT[0]; unitSymbol = OUT[1]; }

# group: Collect info about materials (layers)
code_block_8 = CodeBlock(elem=flatten_2) { elem; }
turn_into_list = CodeBlock(x=code_block_8) { List.Flatten([x]); }
returnPaintMaterials = BoolSelector(false)
py_material_clockwork = Python(IN[0]=turn_into_list, IN[1]=returnPaintMaterials)  # CPython3
# ---------- py_material_clockwork.python (22 lines) ----------
import clr
clr.AddReference('RevitAPI')
from Autodesk.Revit.DB import *

items = UnwrapElement(IN[0])
paintedmats = IN[1]
elementmats = list()
elementareas = list()
elementvols = list()

for item in items:
	matlist = list()
	arealist = list()
	vollist = list()
	for matid in item.GetMaterialIds(paintedmats):
		matlist.append(item.Document.GetElement(matid))
		arealist.append(item.GetMaterialArea(matid,paintedmats))
		vollist.append(item.GetMaterialVolume(matid))
	elementmats.append(matlist)
	elementareas.append(arealist)
	elementvols.append(vollist)
OUT = (elementmats,elementareas,elementvols)
# ----------------------------------------
code_block_9 = CodeBlock(OUT=py_material_clockwork) { OUT[0]; OUT[1]; OUT[2]; }
code_block_10 = CodeBlock(value=code_block_9.out1, displayUnitType=code_block_6.displayUnitType, RevitVersion=code_block_5) { value; displayUnitType; RevitVersion; }
py_internalunit_todisplayunit = Python(IN[0]=code_block_10.value, IN[1]=code_block_10.displayUnitType, IN[2]=code_block_10.RevitVersion)  # "Py InternalUnit.ToDisplayUnit (Clockwork)"; CPython3
# ---------- py_internalunit_todisplayunit.python (26 lines) ----------
import clr
clr.AddReference('RevitAPI')
from Autodesk.Revit.DB import *

def FromInternalUnits(val, unittype):
	if (version > 2021 and str(dispunit.GetType()) == "Autodesk.Revit.DB.ForgeTypeId") or (version < 2022 and str(dispunit.GetType()) == "Autodesk.Revit.DB.DisplayUnitType"):
		return UnitUtils.ConvertFromInternalUnits(val,unittype)
	else: return None

vals = IN[0]
dispunit = IN[1]
version = IN[2]

# turn into list of lists:
if not isinstance(vals[0], list):
    vals = [vals]
if not isinstance(vals[0], list):
    vals = [vals]

OUT = []

for list in vals:
	inner = []
	for x in list:
		inner.append(FromInternalUnits(x, dispunit))
	OUT.append(inner)
# ----------------------------------------
py_returnlistorsinglevalue = Python(IN[0]=code_block_8, IN[1]=py_internalunit_todisplayunit)  # CPython3
# ---------- py_returnlistorsinglevalue.python (4 lines) ----------
check = IN[0]
items = IN[1]
if isinstance(check, (list)): OUT = items
else: OUT = items[0]
# ----------------------------------------
code_block_11 = CodeBlock(materialAreas=py_returnlistorsinglevalue) { materialAreas; }  # frozen
isEmpty = List.IsEmpty()  # unwired: list
map = List.Map(list=code_block_9.out0, function=isEmpty)
not_ = Not(x=map)
py_returnlistorsinglevalue_2 = Python(IN[0]=code_block_8, IN[1]=not_)  # CPython3; same code as py_returnlistorsinglevalue
code_block_12 = CodeBlock(hasMaterial=py_returnlistorsinglevalue_2) { hasMaterial; }
py_returnlistorsinglevalue_3 = Python(IN[0]=code_block_8, IN[1]=code_block_9.out0)  # CPython3; same code as py_returnlistorsinglevalue
code_block_13 = CodeBlock(materials=py_returnlistorsinglevalue_3) { materials; }
name = Material.Name(material=code_block_13)
code_block_14 = CodeBlock(value=code_block_9.out2, displayUnitType=code_block_7.displayUnitType, RevitVersion=code_block_5) { value; displayUnitType; RevitVersion; }
py_internalunit_todisplayunit_2 = Python(IN[0]=code_block_14.value, IN[1]=code_block_14.displayUnitType, IN[2]=code_block_14.RevitVersion)  # "Py InternalUnit.ToDisplayUnit (Clockwork)"; CPython3; same code as py_internalunit_todisplayunit
py_returnlistorsinglevalue_4 = Python(IN[0]=code_block_8, IN[1]=py_internalunit_todisplayunit_2)  # CPython3; same code as py_returnlistorsinglevalue
code_block_15 = CodeBlock(materialVolumes=py_returnlistorsinglevalue_4) { materialVolumes; }

# group: Check geometrical volume
code_block_16 = CodeBlock { elem; }  # frozen; unwired: elem
code_block_17 = CodeBlock { "Volume"; }
getParameterValueByName = Element.GetParameterValueByName(element=code_block_16, parameterName=code_block_17)
sum = Math.Sum(values=getParameterValueByName)
sum_2 = Math.Sum(values=sum)
watch = Watch(sum_2)
geometry = Element.Geometry(element=code_block_16)  # frozen
flatten_3 = List.Flatten(list=geometry)
volume = Solid.Volume(solid=flatten_3)
sum_3 = Math.Sum(values=volume)
code_block_18 = CodeBlock(x=sum_3) { x/1000000000; }
watch_2 = Watch(code_block_18)

string = StringInput(".\data\Lifespan_expectancy.json")  # frozen
file_from_path = FileObject(path=string)
readText = FileSystem.ReadText(file=file_from_path)

# group: TODO
code_block_19 = CodeBlock()  # // Compute volumes for non volumetric elements (now foundations fail!)

# group: Load mapping data and code
string_2 = StringInput(".\snippets\MCI_calculator.py")
file_from_path_2 = FileObject(path=string_2)
readText_2 = FileSystem.ReadText(file=file_from_path_2)

# group: Load input data
string_3 = StringInput(".\data\Material_data.json")
file_from_path_3 = FileObject(path=string_3)
readText_3 = FileSystem.ReadText(file=file_from_path_3)
parseJSON = Data.ParseJSON(json=readText_3)

# group: Load code
string_4 = StringInput(".\snippets\Add_steel_to_RC.py")
file_from_path_4 = FileObject(path=string_4)
readText_4 = FileSystem.ReadText(file=file_from_path_4)

# group: Load mapping data and code
string_5 = StringInput(".\snippets\Map_names.py")
file_from_path_5 = FileObject(path=string_5)
readText_5 = FileSystem.ReadText(file=file_from_path_5)
string_6 = StringInput(".\data\Material_mapping.json")
file_from_path_6 = FileObject(path=string_6)
readText_6 = FileSystem.ReadText(file=file_from_path_6)

# group: Match materials
code_block_20 = CodeBlock(materials=name) { materials; }
py_match_material_names = PythonStringNode(script=readText_5, IN[0]=readText_6, IN[1]=code_block_20)  # CPython3

# group: Split RC into steel and concrete (using constant ratio)
code_block_21 = CodeBlock(original_materials=code_block_20, materials=py_match_material_names, volumes=code_block_15) { original_materials; materials; volumes; steel_concrete_ratio = 0.025; }
py_add_steel_to_rc = PythonStringNode(script=readText_4, IN[0]=code_block_21.original_materials, IN[1]=code_block_21.materials, IN[2]=code_block_21.volumes, IN[3]=code_block_21.steel_concrete_ratio)  # CPython3
code_block_22 = CodeBlock(OUT=py_add_steel_to_rc) { materials = OUT[0]; volumes = OUT[1]; original_materials = OUT[2]; }

# group: Filter by volume
code_block_23 = CodeBlock(original_material=code_block_22.original_materials, material_name=code_block_22.materials, material_volume=code_block_22.volumes) { original_material; material_name; material_volume; }
sum_4 = Math.Sum(values=code_block_23.material_volume)
code_block_24 = CodeBlock { 0; 0.0001; }
eq = Equals(x=sum_4, y=code_block_24.out0, tolerance=code_block_24.out1)
filterByBoolMask = List.FilterByBoolMask(list=code_block_23.material_name, mask=eq)
filterByBoolMask_2 = List.FilterByBoolMask(list=code_block_23.material_volume, mask=eq)
code_block_25 = CodeBlock { 0; 0.0001; }
eq_2 = Equals(x=filterByBoolMask_2.out, y=code_block_25.out0, tolerance=code_block_25.out1)
filterByBoolMask_3 = List.FilterByBoolMask(list=filterByBoolMask.out, mask=eq_2)
flatten_4 = List.Flatten(list=filterByBoolMask_3.out)
code_block_26 = CodeBlock(elements=flatten_2) { elements; }
filterByBoolMask_4 = List.FilterByBoolMask(list=code_block_26, mask=eq)
code_block_27 = CodeBlock(elements=filterByBoolMask_4.out) { elements; }
filterByBoolMask_5 = List.FilterByBoolMask(list=code_block_23.original_material, mask=eq)
filterByBoolMask_6 = List.FilterByBoolMask(list=filterByBoolMask_5.out, mask=eq_2)
flatten_5 = List.Flatten(list=filterByBoolMask_6.out)
filterByBoolMask_7 = List.FilterByBoolMask(list=filterByBoolMask_2.out, mask=eq_2)
count = List.Count(list=filterByBoolMask_7.out, lacing=Longest)
flatten_6 = List.Flatten(list=filterByBoolMask_7.out)

# group: Extract data for each material
code_block_28 = CodeBlock(data=parseJSON, material=flatten_4)
# ---------- code_block_28.designscript (18 lines) ----------
[
Dictionary.ValueAtKey(Dictionary.ValueAtKey(data, material), "C_C"),
Dictionary.ValueAtKey(Dictionary.ValueAtKey(data, material), "E_R"),
Dictionary.ValueAtKey(Dictionary.ValueAtKey(data, material), "HHV"),
Dictionary.ValueAtKey(Dictionary.ValueAtKey(data, material), "M_B"),
Dictionary.ValueAtKey(Dictionary.ValueAtKey(data, material), "B_C"),
Dictionary.ValueAtKey(Dictionary.ValueAtKey(data, material), "E_F"),
Dictionary.ValueAtKey(Dictionary.ValueAtKey(data, material), "E_C")
];
[
Dictionary.ValueAtKey(Dictionary.ValueAtKey(data, material), "F_S"),
Dictionary.ValueAtKey(Dictionary.ValueAtKey(data, material), "F_R"),
Dictionary.ValueAtKey(Dictionary.ValueAtKey(data, material), "F_U"),
Dictionary.ValueAtKey(Dictionary.ValueAtKey(data, material), "C_R"),
Dictionary.ValueAtKey(Dictionary.ValueAtKey(data, material), "C_U")
];

Dictionary.ValueAtKey(Dictionary.ValueAtKey(data, material), "Density");
# ----------------------------------------
code_block_29 = CodeBlock(volume=flatten_6, density=code_block_28.out2) { Mass=volume*density; }

# group: Divide into categories and building layers
code_block_30 = CodeBlock(elements=code_block_27) { elements; }
getCategory = Element.GetCategory(element=code_block_30)
string_from_object = FromObject(object=getCategory)
code_block_31 = CodeBlock { "Building layer"; }
getParameterValueByName_2 = Element.GetParameterValueByName(element=code_block_30, parameterName=code_block_31, lacing=Longest)
string_from_object_2 = FromObject(object=getParameterValueByName_2)
code_block_32 = CodeBlock { ids = [1,2,4]; values = [0.2,0.7,0.9]; names = ["Stru","Skin","Plan"]; not_found = 0; }
py_replace_values = Python(IN[0]=string_from_object, IN[1]=string_from_object_2, IN[2]=code_block_32.ids, IN[3]=code_block_32.values, IN[4]=code_block_32.names, IN[5]=code_block_32.not_found)  # CPython3
# ---------- py_replace_values.python (22 lines) ----------
categories = IN[0]
layers = IN[1]
ids = IN[2]
values = IN[3]
names = IN[4]
not_found = IN[5]

OUT1 = []
OUT2 = []
for i in range(len(layers)):
    found = False
    for j in range(len(ids)):
        if int(layers[i]) == int(ids[j]):
            OUT1.append(values[j])
            OUT2.append(names[j]+" "+categories[i])
            found = True
    if not found:
        OUT1.append(not_found)
        OUT2.append("? "+categories[i])
        

OUT = [OUT1, OUT2]
# ----------------------------------------
code_block_33 = CodeBlock(OUT=py_replace_values) { building_layers = OUT[0]; categories = OUT[1]; }

# group: Load mapping data and code
string_7 = StringInput(".\snippets\Disassembly_indicator.py")
file_from_path_7 = FileObject(path=string_7)
readText_7 = FileSystem.ReadText(file=file_from_path_7)
string_8 = StringInput(".\data\Disassembly_data.json")
file_from_path_8 = FileObject(path=string_8)
readText_8 = FileSystem.ReadText(file=file_from_path_8)

# group: Calculate Disassembly Index
code_block_34 = CodeBlock(elements=code_block_27) { elements; }
code_block_35 = CodeBlock()
# ---------- code_block_35.designscript (4 lines) ----------
["Connection type",
"Connection accessibility",
"Crossings",
"Form containment"];
# ----------------------------------------
getParameterValueByName_3 = Element.GetParameterValueByName(element=code_block_34, parameterName=code_block_35, lacing=CrossProduct)
python_script_from_string = PythonStringNode(script=readText_7, IN[0]=getParameterValueByName_3, IN[1]=readText_8)  # CPython3
sum_5 = Math.Sum(values=python_script_from_string, lacing=Longest)
code_block_36 = CodeBlock(DI=sum_5)
# ---------- code_block_36.designscript (3 lines) ----------
//Disassembly index
DI;
//(the higher the better, max 4.0, min 0.4)
# ----------------------------------------

code_block_37 = CodeBlock(elements=code_block_27, mat_org_names=flatten_5, mat_names=flatten_4, mat_count=count, mat_volume=flatten_6, mat_density=code_block_28.out2, mat_mass=code_block_29, categories=code_block_33.categories, bld_layers=code_block_33.building_layers, disassembly_ind=code_block_36)
# ---------- code_block_37.designscript (12 lines) ----------
[
elements,
mat_org_names,
mat_names,
mat_count,
mat_volume,
mat_density,
mat_mass,
categories,
bld_layers,
disassembly_ind
];
# ----------------------------------------

# group: Replace empty values with defaults from JSON
transpose = List.Transpose(lists=code_block_28.out1)
code_block_38 = CodeBlock(product_data=code_block_37) { IN = product_data; elements = IN[0]; mat_count = IN[3]; }
code_block_39 = CodeBlock()
# ---------- code_block_39.designscript (7 lines) ----------
[
"Biological material",
"Recycled material",
"Reused material",
"EoL recycling",
"Eol reuse"
];
# ----------------------------------------
getParameterValueByName_4 = Element.GetParameterValueByName(element=code_block_38.elements, parameterName=code_block_39, lacing=CrossProduct)
ofRepeatedItem = List.OfRepeatedItem(item=getParameterValueByName_4, amount=code_block_38.mat_count, lacing=Longest)
code_block_40 = CodeBlock { 1; }
flatten_7 = List.Flatten(list=ofRepeatedItem, amt=code_block_40)
python_script_3 = Python(IN[0]=transpose, IN[1]=flatten_7)  # CPython3
# ---------- python_script_3.python (10 lines) ----------
OUT = []

for i in range(len(IN[1])):
	sub = []
	for j in range(len(IN[1][i])):
		if IN[1][i][j] == "":
			sub.append(IN[0][i][j])
		else:
			sub.append(IN[1][i][j]/100)
	OUT.append(sub)
# ----------------------------------------
transpose_2 = List.Transpose(lists=python_script_3)
code_block_41 = CodeBlock(OUT=transpose_2)
# ---------- code_block_41.designscript (7 lines) ----------
[
OUT[0],
OUT[1],
OUT[2],
OUT[3],
OUT[4]
];
# ----------------------------------------
join = List.Join(list0=code_block_28.out0, list1=code_block_41)

# group: Material Circularity Indicator calculations
code_block_42 = CodeBlock(Material_data=join, product_data=code_block_37) { Material_data; mat_mass = product_data[6]; }
python_script_from_string_2 = PythonStringNode(script=readText_2, IN[0]=code_block_42.Material_data, IN[1]=code_block_42.mat_mass)  # CPython3
code_block_43 = CodeBlock(OUT=python_script_from_string_2)
# ---------- code_block_43.designscript (12 lines) ----------
E_E = OUT[0];
C_E = OUT[1];
W_0 = OUT[2];
W_F = OUT[3];
W_C = OUT[4];
V = OUT[5];
W = OUT[6];
LFI = OUT[7];
X = OUT[8];
MCI = OUT[9];
V2 = OUT[5];
V3 = OUT[5];
# ----------------------------------------

# group: Product Circularity Indicator calculations
code_block_44 = CodeBlock(MCI=code_block_43.MCI, count=count, product_data=code_block_37) { MCI; count; mat_mass = product_data[6]; disassembly_ind = product_data[9]; }
chop = List.Chop(list=code_block_44.MCI, lengths=code_block_44.count)
chop_2 = List.Chop(list=code_block_44.mat_mass, lengths=code_block_44.count)
mul = chop * chop_2
sum_6 = Math.Sum(values=mul)
sum_7 = Math.Sum(values=chop_2)
div = sum_6 / sum_7
code_block_45 = CodeBlock(temp=div, DI=code_block_44.disassembly_ind)
# ---------- code_block_45.designscript (2 lines) ----------
//Product Circularity Indicator
PCI = temp*DI/4;
# ----------------------------------------
py_in_range_0_1 = Python(IN[0]=code_block_45)  # CPython3
# ---------- py_in_range_0_1.python (5 lines) ----------
x = IN[0]
x2 = [y if y<=1.0 else 1.0 for y in x]
x3 = [y if y>=0.0 else 0.0 for y in x]

OUT = x3
# ----------------------------------------
code_block_46 = CodeBlock(Mj=sum_7) { Mj; }

# group: System Circularity Indicator calculations
code_block_47 = CodeBlock(PCI=py_in_range_0_1, Mj=code_block_46) { temp = PCI*Mj; }
code_block_48 = CodeBlock(product_data=code_block_37) { IN = product_data; elements = IN[0]; categories = IN[7]; }
groupByKey = List.GroupByKey(list=code_block_47, keys=code_block_48.categories)
sum_8 = Math.Sum(values=groupByKey.groups)
code_block_49 = CodeBlock(Mj=code_block_46) { Mj; }
groupByKey_2 = List.GroupByKey(list=code_block_49, keys=code_block_48.categories)
sum_9 = Math.Sum(values=groupByKey_2.groups)
code_block_50 = CodeBlock(temp=sum_8, Ms=sum_9)
# ---------- code_block_50.designscript (3 lines) ----------
//System Circularity Indicator
// SCI = PCI*Mj/Ms;
SCI = temp/Ms;
# ----------------------------------------
py_in_range_0_1_2 = Python(IN[0]=code_block_50)  # CPython3; same code as py_in_range_0_1
groupByKey_3 = List.GroupByKey(list=code_block_48.elements, keys=code_block_48.categories)

# group: Building Circularity Indicator calculations
code_block_51 = CodeBlock(product_data=code_block_37) { IN = product_data; categories = IN[7]; bld_layers = IN[8]; }
groupByKey_4 = List.GroupByKey(list=code_block_51.bld_layers, keys=code_block_51.categories)
average = Math.Average(numbers=groupByKey_4.groups)
code_block_52 = CodeBlock(SCI=py_in_range_0_1_2, BL=average)
# ---------- code_block_52.designscript (5 lines) ----------
//Building Circularity Indicator
//LK = 0.1+0.2+0.7+0.8+0.9+1.0;
//We take only Structure+Skin+SpacePlan
LK = 0.2+0.7+0.9;
BCI = Math.Sum(SCI*BL)/LK;
# ----------------------------------------
py_in_range_0_1_3 = Python(IN[0]=code_block_52.BCI)  # CPython3
# ---------- py_in_range_0_1_3.python (6 lines) ----------
if IN[0] < 0:
    OUT = 0.0
if IN[0] > 1.0:
    OUT = 1.0
else:
    OUT = IN[0]
# ----------------------------------------

code_block_53 = CodeBlock(MCI=code_block_43.MCI, PCI=py_in_range_0_1, SCI=py_in_range_0_1_2, BCI=py_in_range_0_1_3) { MCI; PCI; SCI; BCI; }

# group: Data collection agreement
i_agree_to_share_non_personal = BoolSelector(false)  # "I agree to share non-personal usage information, including: program version, IP address with allocated city and country, list of material names in the project, for the purpose of research and improving the tool. (Read more at project repository on GitHub)."; graph input

# group: Save results to parameter
code_block_54 = CodeBlock { "Material Circularity Indicator"; }
code_block_55 = CodeBlock(MCI=code_block_53.MCI, PCI=code_block_53.PCI, SCI=code_block_53.SCI, BCI=code_block_53.BCI) { MCI; PCI; SCI; BCI; }
setParameterByName = Element.SetParameterByName(parameterName=code_block_54, value=code_block_55.MCI)  # frozen; unwired: element
code_block_56 = CodeBlock(product_data=code_block_37) { IN = product_data; elements = IN[0]; }
code_block_57 = CodeBlock { []; }
code_block_58 = CodeBlock(trueval=code_block_56.elements, falseval=code_block_57, test=i_agree_to_share_non_personal) { result = [trueval, falseval]; result[test ? 0 : 1]; }
code_block_59 = CodeBlock { "Product Circularity Indicator"; }
setParameterByName_2 = Element.SetParameterByName(element=code_block_58.out1, parameterName=code_block_59, value=code_block_55.PCI)
code_block_60 = CodeBlock { "System Circularity Indicator"; }
setParameterByName_3 = Element.SetParameterByName(parameterName=code_block_60, value=code_block_55.SCI)  # frozen; unwired: element
categories_2 = Categories("OST_ProjectInformation")
all_elements_of_category_3 = ElementsOfCategory(Category=categories_2)
code_block_61 = CodeBlock(i=all_elements_of_category_3) { i[0]; }
code_block_62 = CodeBlock(trueval=code_block_61, falseval=code_block_57, test=i_agree_to_share_non_personal) { result = [trueval, falseval]; result[test ? 0 : 1]; }
code_block_63 = CodeBlock { "Building Circularity Indicator"; }
setParameterByName_4 = Element.SetParameterByName(element=code_block_62.out1, parameterName=code_block_63, value=code_block_55.BCI)

# group: Display circularity results in UI
code_block_64 = CodeBlock(PCI=code_block_53.PCI, SCI=code_block_53.SCI, BCI=code_block_53.BCI, categories=groupByKey_3.unique_keys) { PCI; SCI; BCI; categories; }
average_2 = Math.Average(numbers=code_block_64.PCI)
code_block_65 = CodeBlock(x=average_2) { "Your average Product Circularity Indicator is: "+x+"."; }
code_block_66 = CodeBlock { "System Circularity Indicator is:"; }
code_block_67 = CodeBlock(SCI=code_block_64.SCI, cat=code_block_64.categories) { " "+Math.Round(SCI, 2)+" for "+cat; }
code_block_68 = CodeBlock { 4; 4; }
remove = String.Remove(string=code_block_67, startIndex=code_block_68.out0, count=code_block_68.out1)
join_2 = List.Join(list0=code_block_66, list1=remove)
string_from_array = FromArray(array=join_2)
code_block_69 = CodeBlock { 0; 1; }
remove_2 = String.Remove(string=string_from_array, startIndex=code_block_69.out0, count=code_block_69.out1)
code_block_70 = CodeBlock { -1; 1; }
remove_3 = String.Remove(string=remove_2, startIndex=code_block_70.out0, count=code_block_70.out1)
code_block_71 = CodeBlock { 32; 1; }
remove_4 = String.Remove(string=remove_3, startIndex=code_block_71.out0, count=code_block_71.out1)
code_block_72 = CodeBlock(BCI=code_block_64.BCI) { "Your Building Circularity Indicator is: "+BCI+"."; }

# group: Prepare export data
code_block_73 = CodeBlock(product_data=code_block_37)
# ---------- code_block_73.designscript (9 lines) ----------
IN = product_data;
elements = IN[0];
mat_org_names = IN[1];
mat_names = IN[2];
mat_count = IN[3];
mat_volume = IN[4];
mat_density = IN[5];
mat_mass = IN[6];
categories = IN[7];
# ----------------------------------------
ofRepeatedItem_2 = List.OfRepeatedItem(item=code_block_73.elements, amount=code_block_73.mat_count, lacing=Longest)
flatten_8 = List.Flatten(list=ofRepeatedItem_2)
id = Element.Id(element=flatten_8)
ofRepeatedItem_3 = List.OfRepeatedItem(item=code_block_73.categories, amount=code_block_73.mat_count, lacing=Longest)
flatten_9 = List.Flatten(list=ofRepeatedItem_3)
code_block_74 = CodeBlock { "Type"; }
getParameterValueByName_5 = Element.GetParameterValueByName(element=flatten_8, parameterName=code_block_74)
code_block_75 = CodeBlock { "Type Name"; }
getParameterValueByName_6 = Element.GetParameterValueByName(element=getParameterValueByName_5, parameterName=code_block_75)
code_block_76 = CodeBlock(MCI_result=python_script_from_string_2) { OUT = MCI_result; W_0 = OUT[2]; V = OUT[5]; LFI = OUT[7]; MCI = OUT[9]; }
code_block_77 = CodeBlock(Material_data=join) { IN = Material_data; F_R = IN[8]; F_U = IN[9]; F_S = IN[7]; C_R = IN[10]; C_U = IN[11]; }
code_block_78 = CodeBlock(product_id=id, product_category=flatten_9, product_name=getParameterValueByName_6, original_material=code_block_73.mat_org_names, material_name=code_block_73.mat_names, material_volume=code_block_73.mat_volume, material_density=code_block_73.mat_density, material_weight=code_block_73.mat_mass, V=code_block_76.V, F_R=code_block_77.F_R, F_U=code_block_77.F_U, F_S=code_block_77.F_S, C_R=code_block_77.C_R, C_U=code_block_77.C_U, W_0=code_block_76.W_0, Linear_flow_index=code_block_76.LFI, MCI=code_block_76.MCI)
# ---------- code_block_78.designscript (19 lines) ----------
[
product_id,
product_category,
product_name,
original_material,
material_name,
material_volume,
material_density,
material_weight,
V,
F_R,
F_U,
F_S,
C_R,
C_U,
W_0,
Linear_flow_index,
MCI
];
# ----------------------------------------

# group: Prepare export data
code_block_79 = CodeBlock(product_data=code_block_37)
# ---------- code_block_79.designscript (7 lines) ----------
IN = product_data;
elements = IN[0];
mat_count = IN[3];
mat_volume = IN[4];
mat_mass = IN[6];
categories = IN[7];
disassembly_ind = IN[9];
# ----------------------------------------
id_2 = Element.Id(element=code_block_79.elements)
code_block_80 = CodeBlock { "Type"; }
getParameterValueByName_7 = Element.GetParameterValueByName(element=code_block_79.elements, parameterName=code_block_80)
code_block_81 = CodeBlock { "Type Name"; }
getParameterValueByName_8 = Element.GetParameterValueByName(element=getParameterValueByName_7, parameterName=code_block_81)
chop_3 = List.Chop(list=code_block_79.mat_volume, lengths=code_block_79.mat_count)
sum_10 = Math.Sum(values=chop_3)
code_block_82 = CodeBlock(PCI=py_in_range_0_1) { PCI; }
code_block_83 = CodeBlock(product_id=id_2, product_category=code_block_79.categories, product_name=getParameterValueByName_8, product_volume=sum_10, Disassembly_ind=code_block_79.disassembly_ind, PCI=code_block_82)
# ---------- code_block_83.designscript (8 lines) ----------
[
product_id,
product_category,
product_name,
product_volume,
Disassembly_ind,
PCI
];
# ----------------------------------------

# group: Prepare export data
average_3 = Math.Average(numbers=py_in_range_0_1_2)
code_block_84 = CodeBlock(BCI=py_in_range_0_1_3, SCI=average_3)
# ---------- code_block_84.designscript (4 lines) ----------
[
BCI,
SCI
];
# ----------------------------------------
categories_3 = Categories("OST_ProjectInformation")
all_elements_of_category_4 = ElementsOfCategory(Category=categories_3)
code_block_85 = CodeBlock(i=all_elements_of_category_4) { i[0]; }
code_block_86 = CodeBlock()
# ---------- code_block_86.designscript (5 lines) ----------
[
"Project Name",
"Project Address",
"Author"
];
# ----------------------------------------
getParameterValueByName_9 = Element.GetParameterValueByName(element=code_block_85, parameterName=code_block_86)

# group: Generate Excel report
excel_report_directory_path = Directory("No file selected.")  # graph input
string_9 = StringInput("\")
excel_report_file_name = StringInput("MyCircularityReport")  # graph input
string_10 = StringInput(".xlsx")
concat = String.Concat(string0=excel_report_directory_path, string1=string_9, string2=excel_report_file_name, string3=string_10)
excel_template_file_location = StringInput(".\template\Template_Excel_report.xlsx")
file_from_path_9 = FileObject(path=excel_template_file_location)
boolean = BoolSelector(true)
copyFile = FileSystem.CopyFile(file=file_from_path_9, destinationPath=concat, overwrite=boolean)
code_block_87 = CodeBlock(trueval=concat, falseval=concat, test=copyFile) { result = [trueval, falseval]; result[test ? 0 : 1]; }
code_block_88 = CodeBlock()
# ---------- code_block_88.designscript (4 lines) ----------
["MCI_results",
"PCI_results",
"Report",
"Report"];
# ----------------------------------------
code_block_89 = CodeBlock { []; }
code_block_90 = CodeBlock(trueval=code_block_88, falseval=code_block_89, test=i_agree_to_share_non_personal) { result = [trueval, falseval]; result[test ? 0 : 1]; }
code_block_91 = CodeBlock { [1,1,14,0]; [0,0,4,1]; }
code_block_92 = CodeBlock(trueval=code_block_91.out0, falseval=code_block_89, test=i_agree_to_share_non_personal) { result = [trueval, falseval]; result[test ? 0 : 1]; }
code_block_93 = CodeBlock(trueval=code_block_91.out1, falseval=code_block_89, test=i_agree_to_share_non_personal) { result = [trueval, falseval]; result[test ? 0 : 1]; }
code_block_94 = CodeBlock(MCI_data=code_block_78, PCI_data=code_block_83, Report_data=code_block_84, Project_name=getParameterValueByName_9) { MCI_data; PCI_data; Report_data; Project_name; }
transpose_3 = List.Transpose(lists=code_block_94.MCI_data)
transpose_4 = List.Transpose(lists=code_block_94.PCI_data)
transpose_5 = List.Transpose(lists=code_block_94.Report_data)
transpose_6 = List.Transpose(lists=code_block_94.Project_name)
list_create = List.Create(item0=transpose_3, item1=transpose_4, item2=transpose_5, item3=transpose_6)
code_block_95 = CodeBlock(trueval=list_create, falseval=code_block_89, test=i_agree_to_share_non_personal) { result = [trueval, falseval]; result[test ? 0 : 1]; }
code_block_96 = CodeBlock(data=code_block_95.out1) { data; }
boolean_2 = BoolSelector(false)
exportExcel = Data.ExportExcel(filePath=code_block_87.out1, sheetName=code_block_90.out1, startRow=code_block_92.out1, startCol=code_block_93.out1, data=code_block_96, overWrite=boolean_2)

# group: Info display
code_block_97 = CodeBlock(path=code_block_87.out1) { "You're data was succesfully exported to Excel: "+path; "There was a problem exporting your Excel data."; }
isEmpty_2 = List.IsEmpty(list=exportExcel)
code_block_98 = CodeBlock(trueval=code_block_97.out1, falseval=code_block_97.out0, test=isEmpty_2) { result = [trueval, falseval]; result[test ? 0 : 1]; }
join_3 = List.Join(list0=code_block_65, list1=remove_4, list2=code_block_72, list3=code_block_98.out1)
code_block_99 = CodeBlock { "Please agree to share necesarry information to be able to use the calculation module."; }
code_block_100 = CodeBlock(trueval=join_3, falseval=code_block_99, test=i_agree_to_share_non_personal) { result = [trueval, falseval]; result[test ? 0 : 1]; }
results = Watch(code_block_100.out1)  # graph output

# group: Load code and submit usage statistics
string_11 = StringInput(".\snippets\Usage_statistics.py")
file_from_path_10 = FileObject(path=string_11)
readText_9 = FileSystem.ReadText(file=file_from_path_10)
code_block_101 = CodeBlock(product=code_block_51.IN) { IN = product; IN[1]; IN[4]; IN[7]; }
uniqueItems_2 = List.UniqueItems(list=code_block_101.out1)
python_script_from_string_3 = PythonStringNode(script=readText_9, IN[0]=uniqueItems_2, IN[1]=i_agree_to_share_non_personal)  # CPython3
