# Dynamo graph 3_VisualizeResults.dyn (Dynamo 2.10.1.3976)

# group: READ ME
# note: TBC...

# group: Get elements from groups
categories = Categories("OST_IOSModelGroups")  # frozen
all_elements_of_category = ElementsOfCategory(Category=categories)
getMembers = Group.GetMembers(group=all_elements_of_category)
flatten = List.Flatten(list=getMembers)
uniqueItems = List.UniqueItems(list=flatten)

# group: Collect all elements
code_block = CodeBlock()
# ---------- code_block.designscript (12 lines) ----------
[
"Doors",
"Windows",
"Floors",
"Structural Columns",
"Structural Framing",
"Walls",
"Ceilings",
"Columns",
"Roofs",
"Structural Foundations"
];
# ----------------------------------------
include_the_foundations = BoolSelector(true)  # graph input
code_block_2 = CodeBlock { 9; -1; }
if_ = If(test=include_the_foundations, true=code_block_2.out0, false=code_block_2.out1)
removeItemAtIndex = List.RemoveItemAtIndex(list=code_block, indices=if_)
byName = Category.ByName(name=removeItemAtIndex)
all_elements_of_category_2 = ElementsOfCategory(Category=byName)
flatten_2 = List.Flatten(list=all_elements_of_category_2)

# group: Take all other elements from the view
id = Element.Id(element=flatten_2)
all_elements_in_active_view = ElementsInView()
id_2 = Element.Id(element=all_elements_in_active_view)
python_script = Python(IN[0]=id, IN[1]=id_2)  # IronPython2
# ---------- python_script.python (13 lines) ----------
# Load the Python Standard and DesignScript Libraries
import sys
import clr
clr.AddReference('ProtoGeometry')
from Autodesk.DesignScript.Geometry import *

list_A = IN[0]
list_B = IN[1]

common = set(list_B).intersection(list_A)
difference = set(list_B) - set(list_A)

OUT = [common, difference]
# ----------------------------------------
code_block_3 = CodeBlock(seq=python_script) { common = seq[0]; difference = seq[1]; }
watch = Watch(code_block_3.common)
element_by_id = ElementById(Id=watch)
watch_2 = Watch(code_block_3.difference)
element_by_id_2 = ElementById(Id=watch_2)

code_block_4 = CodeBlock(elem=element_by_id) { elem; }
code_block_5 = CodeBlock()
# ---------- code_block_5.designscript (2 lines) ----------
"Product Circularity Indicator";
//"System Circularity Indicator";
# ----------------------------------------
getParameterValueByName = Element.GetParameterValueByName(element=code_block_4, parameterName=code_block_5)
code_block_6 = CodeBlock { ""; }
eq = code_block_6 == getParameterValueByName
filterByBoolMask = List.FilterByBoolMask(list=getParameterValueByName, mask=eq)
filterByBoolMask_2 = List.FilterByBoolMask(list=code_block_4, mask=eq)

# group: Color in view by indicator
code_block_7 = CodeBlock(numbers=filterByBoolMask.out, elements=filterByBoolMask_2.out) { numbers; elements; }
code_block_8 = CodeBlock { 0.25; }
ge = code_block_7.numbers >= code_block_8
filterByBoolMask_3 = List.FilterByBoolMask(list=code_block_7.elements, mask=ge)
code_block_9 = CodeBlock { 0.5; }
lt = code_block_7.numbers < code_block_9
and_ = ge && lt
filterByBoolMask_4 = List.FilterByBoolMask(list=code_block_7.elements, mask=and_)
ge_2 = code_block_7.numbers >= code_block_9
code_block_10 = CodeBlock { 0.75; }
lt_2 = code_block_7.numbers < code_block_10
and_2 = ge_2 && lt_2
filterByBoolMask_5 = List.FilterByBoolMask(list=code_block_7.elements, mask=and_2)
filterByBoolMask_6 = List.FilterByBoolMask(list=code_block_7.elements, mask=lt_2)
code_block_11 = CodeBlock(group1=filterByBoolMask_3.out, group2=filterByBoolMask_4.in, group3=filterByBoolMask_5.in, group4=filterByBoolMask_6.out) { group1; group2; group3; group4; }
join = List.Join(list0=code_block_11.group1, list1=code_block_11.group2, list2=code_block_11.group3, list3=code_block_11.group4)
code_block_12 = CodeBlock()
# ---------- code_block_12.designscript (4 lines) ----------
Color.ByARGB(255, 28, 28, 28);
Color.ByARGB(255, 62, 164, 164);
Color.ByARGB(135, 215, 197, 0);
Color.ByARGB(135, 0, 149, 84);
# ----------------------------------------
count = List.Count(list=code_block_11.group1)
ofRepeatedItem = List.OfRepeatedItem(item=code_block_12.out0, amount=count)
count_2 = List.Count(list=code_block_11.group2)
ofRepeatedItem_2 = List.OfRepeatedItem(item=code_block_12.out1, amount=count_2)
count_3 = List.Count(list=code_block_11.group3)
ofRepeatedItem_3 = List.OfRepeatedItem(item=code_block_12.out2, amount=count_3)
count_4 = List.Count(list=code_block_11.group4)
ofRepeatedItem_4 = List.OfRepeatedItem(item=code_block_12.out3, amount=count_4)
join_2 = List.Join(list0=ofRepeatedItem, list1=ofRepeatedItem_2, list2=ofRepeatedItem_3, list3=ofRepeatedItem_4)
code_block_13 = CodeBlock()
# ---------- code_block_13.designscript (4 lines) ----------
Color.ByARGB(255, 68, 68, 68);
Color.ByARGB(255, 102, 204, 204);
Color.ByARGB(135, 255, 237, 0);
Color.ByARGB(135, 0, 189, 124);
# ----------------------------------------
ofRepeatedItem_5 = List.OfRepeatedItem(item=code_block_13.out0, amount=count)
ofRepeatedItem_6 = List.OfRepeatedItem(item=code_block_13.out1, amount=count_2)
ofRepeatedItem_7 = List.OfRepeatedItem(item=code_block_13.out2, amount=count_3)
ofRepeatedItem_8 = List.OfRepeatedItem(item=code_block_13.out3, amount=count_4)
join_3 = List.Join(list0=ofRepeatedItem_5, list1=ofRepeatedItem_6, list2=ofRepeatedItem_7, list3=ofRepeatedItem_8)
code_block_14 = CodeBlock { "<Solid fill>"; }
getByName = FillPatternElement.GetByName(name=code_block_14)
byProperties = Revit.Filter.OverrideGraphicSettings.ByProperties(cutFillColor=join_2, projectionFillColor=join_3, cutLineColor=join_2, projectionLineColor=join_2, cutFillPattern=getByName, projectionFillPattern=getByName)
overrideInView = Element.OverrideInView(element=join, overrides=byProperties)
code_block_15 = CodeBlock()  # frozen
# ---------- code_block_15.designscript (12 lines) ----------
[
Color.ByARGB(255, 68, 68, 68),
Color.ByARGB(255, 102, 204, 204),
Color.ByARGB(255, 255, 237, 0),
Color.ByARGB(255, 0, 189, 124)
];
[
0.00,
0.33,
0.66,
1.00
];
# ----------------------------------------
color_range = ColorRange(colors=code_block_15.out0, indices=code_block_15.out1, value=code_block_15.out1)
code_block_16 = CodeBlock()  # frozen
# ---------- code_block_16.designscript (16 lines) ----------
//project colors:
//green, yellow, light blue, dark gray, magenta
[
Color.ByARGB(255, 0, 189, 124),
Color.ByARGB(255, 255, 237, 0),
Color.ByARGB(255, 102, 204, 204),
Color.ByARGB(255, 68, 68, 68),
Color.ByARGB(255, 236, 26, 146)
];
[
0.00,
0.25,
0.50,
0.75,
1.00
];
# ----------------------------------------
code_block_17 = CodeBlock()  # frozen
# ---------- code_block_17.designscript (9 lines) ----------
//yellow to green
[
Color.ByARGB(135, 255, 237, 0),
Color.ByARGB(135, 0, 189, 124)
];
[
0.00,
1.00
];
# ----------------------------------------

# group: Color those that have no indicator
code_block_18 = CodeBlock(elements=filterByBoolMask_2.in) { elements; }
code_block_19 = CodeBlock { Color.ByARGB(255, 68, 68, 68); }
fill_patterns = FillPatterns("<Solid fill>")
byProperties_2 = Revit.Filter.OverrideGraphicSettings.ByProperties(projectionFillColor=code_block_19, projectionLineColor=code_block_19, projectionFillPattern=fill_patterns)
overrideInView_2 = Element.OverrideInView(element=code_block_18, overrides=byProperties_2)

# group: Color all unwanted elements gray and transparent.
code_block_20 = CodeBlock(elements=element_by_id_2) { elements; }
code_block_21 = CodeBlock { 100; }
byARGB = Color.ByARGB(r=code_block_21, g=code_block_21, b=code_block_21)
code_block_22 = CodeBlock { 150; }
byARGB_2 = Color.ByARGB(r=code_block_22, g=code_block_22, b=code_block_22)
fill_patterns_2 = FillPatterns("<Solid fill>")
code_block_23 = CodeBlock { 80; }
byProperties_3 = Revit.Filter.OverrideGraphicSettings.ByProperties(projectionFillColor=byARGB, projectionLineColor=byARGB_2, projectionFillPattern=fill_patterns_2, transparency=code_block_23)
overrideInView_3 = Element.OverrideInView(element=code_block_20, overrides=byProperties_3)

# group: Relative values (not absolute)
code_block_24 = CodeBlock { 0.00; 1.00; }  # frozen
remapRange = Math.RemapRange(numbers=filterByBoolMask.out, newMin=code_block_24.out0, newMax=code_block_24.out1)

sort = List.Sort(list=filterByBoolMask.out)
